# Grasshopper definition hb_RhinoToRevit.gh (Grasshopper 0.9.76)
# plug-ins: Hummingbird, PTComponentLibrary

brep = Brep(<brep referenced from the Rhino model>)
join = BrepJoin(Breps=brep)  # -> Breps, Closed
panel = Panel(join.Breps)

# ---- group: Floor Slabs / Building 1 Brep
# Verify that there are no duplicate
# elements in the same place in the Rhino
# model.  For example, 2 identical slabs in
# the same place.
brep_2 = Brep([<brep referenced from the Rhino model> x44])

# ---- group: Floor Slabs / Building 2 Brep
brep_3 = Brep([<brep referenced from the Rhino model> x89])

# ---- group: Floor Slabs / Building 3 Brep
brep_4 = Brep([<brep referenced from the Rhino model> x52])

# ---- group: Floor Slabs / Building 4 (Pavilion) Brep
brep_5 = Brep([<brep referenced from the Rhino model> x8])

# ---- group: Building 1 Glass Brep
brep_6 = Brep([<brep referenced from the Rhino model> x333])

# ---- group: Building 1 Glass Railing Brep
brep_7 = Brep([<brep referenced from the Rhino model> x147])

# ----
# This instance has the correct methodology
# for extracting surfaces from the floor plates.
brep_8 = Brep([join.Breps, brep_2])

# ---- group: Reference all floors into a single BRep from Rhino Model / Building 1 Brep
# FLOORS &
# LEVELS
brep_9 = Brep([<brep referenced from the Rhino model> x45])

# ---- group: Reference all floors into a single BRep from Rhino Model / Building 2 Brep
brep_10 = Brep([<brep referenced from the Rhino model> x89])

# ---- group: Reference all floors into a single BRep from Rhino Model / Building 3 Brep
brep_11 = Brep([<brep referenced from the Rhino model> x52])

# ---- group: Reference all floors into a single BRep from Rhino Model / Building 4 Brep
brep_12 = Brep([<brep referenced from the Rhino model> x8])

# ---- group: Sample Geometry
brep_13 = Brep([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])

# ----
debrep = DeconstructBrep(Brep=brep_6)  # -> Faces, Edges, Vertices

# ---- group: Reference a single BRep from Rhino Model / Lower Mass
# GRIDS
brep_14 = Brep(<brep referenced from the Rhino model>)

# ---- group: Reference a single BRep from Rhino Model / Upper Mass
brep_15 = Brep(<brep referenced from the Rhino model>)

# ---- group: Attach Brep Here
brep_16 = Brep(brep_8)

# ----
edges = BrepEdges(Brep=brep_6)  # -> Naked, Interior, NonManifold

# ---- group: Building 1 Glass Brep
brep_17 = Brep([<brep referenced from the Rhino model> x333])

# ---- group: Building 1 Glass Railing Brep
brep_18 = Brep([<brep referenced from the Rhino model> x147])

# ---- group: Attach Brep Here
project = Project(Plane=PlaneXY(0, 0, 0))  # -> Geometry, Transform

# ----
Z = UnitZ(Factor=debrep.Edges)
X = UnitX(Factor=debrep.Edges)
panel_2 = Panel(debrep.Edges)

# ---- group: Attach Brep Here
# Verify that there are no
# duplicate elements in the
# same place in the Rhino
# model.  For example, 2
# identical slabs in the same
# place.
brep_19 = Brep()

# ----
crv = Curve(edges.Naked)
crv_2 = Curve(edges.Interior)
debrep_2 = DeconstructBrep(Brep=brep_17)  # -> Faces, Edges, Vertices

# ---- group: Modify grid offset from perimeter
y_axis_offset = Slider(3.1, range=0..5)
x_axis_offset = Slider(4.1, range=0..5)

# ----
panel_3 = Panel(X)

debrep_3 = DeconstructBrep(Brep=brep_19)  # -> Faces, Edges, Vertices
boxprop = BoxProperties(Box=brep_19)  # -> Center, Diagonal, Area, Volume, Degeneracy
division = Division(A=boxprop.Volume, B=boxprop.Area)
division_2 = Division(A=division, B="2")
vec = VectorXYZ(XComponent=0, YComponent=0, ZComponent=division_2)  # -> Vector, Length
move = Move(Geometry=boxprop.Center, Motion=vec.Vector)  # -> graft(Geometry), Transform
Z_2 = UnitZ(Factor=1)
project_2 = ProjectPoint(Point=move.Geometry, Direction=Z_2, Geometry=debrep_3.Faces)  # -> Point, Index
item = ListItem(List=debrep_3.Faces, Index=project_2.Index, Wrap=True)
srf = Surface(item)
srf_2 = Surface(flatten(srf))
join_2 = BrepJoin(Breps=srf_2)  # -> Breps, Closed
srf_3 = Surface(join_2.Breps)

edges_2 = BrepEdges(Brep=brep_17)  # -> Naked, Interior, NonManifold
brep_20 = Brep([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])

brep_21 = Brep([<brep referenced from the Rhino model> x87])
debrep_4 = DeconstructBrep(Brep=brep_21)  # -> Faces, Edges, Vertices
pt = Point(debrep_4.Vertices)
panel_4 = Panel(pt)
panel_5 = Panel("C:\Users\hans.palacios\Documents\My Files\01_DTM\Tickets\20170208 - Rhino To Revit\RhinoExport")
loftforms = LoftForms(WriteToggle=Toggle(False), FolderPath=panel_5, CsvFileName="wallsPrecast", Points=pt, LoftMode=1)  # -> Output, Data
panel_6 = Panel(loftforms.Data)
panel_7 = Panel(loftforms.Output)

brep_22 = Brep([<brep referenced from the Rhino model> x528])
Z_3 = UnitZ(Factor=debrep_2.Edges)
brep_23 = Brep([<brep referenced from the Rhino model> x5])
X_2 = UnitX(Factor=debrep_2.Edges)
debrep_5 = DeconstructBrep(Brep=brep_20)  # -> Faces, Edges, Vertices
panel_8 = Panel(debrep_2.Edges)
boxprop_2 = BoxProperties(Box=brep_20)  # -> Center, Diagonal, Area, Volume, Degeneracy
crv_3 = Curve(edges_2.Naked)
crv_4 = Curve(edges_2.Interior)
debrep_6 = DeconstructBrep(Brep=brep_23)  # -> Faces, Edges, Vertices
division_3 = Division(A=boxprop_2.Volume, B=boxprop_2.Area)
panel_9 = Panel(X_2)
division_4 = Division(A=division_3, B="2")
pt_2 = Point(debrep_6.Vertices)
crv_5 = Curve(debrep_6.Edges)
srf_4 = Surface(debrep_6.Faces)

# ----
# GRIDS
# Process to create grid from points
boxprop_3 = BoxProperties(Box=brep_16)  # -> Center, Diagonal, Area, Volume, Degeneracy
pt_3 = Point(boxprop_3.Center)
pdecon = Deconstruct(Point=pt_3)  # -> XComponent, YComponent, ZComponent
sort = SortList(Keys=pdecon.ZComponent, ValuesA=brep_16)  # -> Keys, ValuesA
item_2 = ListItem(List=flatten(sort.ValuesA), Index="0", Wrap=True)
project_3 = Project(Geometry=item_2, Plane=PlaneXY(0, 0, 0))  # -> Geometry, Transform
box_corners = BoxCorners(Box=project_3.Geometry)  # -> CornerA, CornerB, CornerC, CornerD, CornerE, CornerF, CornerG, CornerH
grid = Slider(6, range=0..15)
ln = Line(StartPoint=box_corners.CornerA, EndPoint=box_corners.CornerB)
ln_2 = Line(StartPoint=box_corners.CornerB, EndPoint=box_corners.CornerC)
ln_3 = Line(StartPoint=box_corners.CornerC, EndPoint=box_corners.CornerD)
grid_2 = Slider(19, range=0..40)
arrcurve = CurveArray(Geometry=ln_2, Curve=ln_3, Count=grid)  # -> Geometry, Transform
extension = Slider(12, range=0..15)
arrcurve_2 = CurveArray(Geometry=ln, Curve=ln_2, Count=grid_2)  # -> Geometry, Transform
ext = ExtendCurve(Curve=[arrcurve_2.Geometry, arrcurve.Geometry], Type=0, Start=extension, End=extension)

vec_2 = VectorXYZ(XComponent=0, YComponent=0, ZComponent=division_4)  # -> Vector, Length

# ---- group: Graft to add branch to align with other tree
move_2 = Move(Geometry=boxprop_2.Center, Motion=vec_2.Vector)  # -> graft(Geometry), Transform

# ----
cp = ControlPoints(Curve=crv_5)  # -> Points, Weights, Knots
walls = Walls()  # -> Output, Data
Z_4 = UnitZ(Factor=1)
panel_10 = Panel("C:\Users\hans.palacios\Documents\My Files\01_DTM\Tickets\20170208 - Rhino To Revit\RhinoExport")
project_4 = ProjectPoint(Point=move_2.Geometry, Direction=Z_4, Geometry=debrep_5.Faces)  # -> Point, Index
panel_11 = Panel(cp.Points)

# ---- group: True - Export
toggle = BooleanToggle(False)

# ----
panel_12 = Panel(move_2.Geometry)
panel_13 = Panel("C:\Users\hans.palacios\Documents\My Files\01_DTM\Tickets\20170208 - Rhino To Revit\RhinoExport")
item_3 = ListItem(List=debrep_5.Faces, Index=project_4.Index, Wrap=True)

# ---- group: Modify number of grids along axis
y_axis_grid = Slider(5, range=0..15)
x_axis_grid = Slider(14, range=0..40)

# ---- group: Modify to extend grid end points
grid_line_extension = Slider(4, range=0..15)

# ----
panel_14 = Panel(project_4.Index)
srf_5 = Surface(item_3)
loftforms_2 = LoftForms(WriteToggle=toggle, FolderPath=panel_10, CsvFileName="glazing2", Points=cp.Points, LoftMode=1)  # -> Output, Data

# ---- group: True - Export
toggle_2 = BooleanToggle(False)

# ----
panel_15 = Panel(loftforms_2.Output)
panel_16 = Panel(loftforms_2.Data)

# ---- group: Floor1 - Extract curves from surfaces & join individual curves into closed curves per level
edges_3 = BrepEdges(Brep=srf_3)  # -> Naked, Interior, NonManifold
crv_6 = Curve(edges_3.Naked)
join_3 = JoinCurves(Curves=crv_6, Preserve=Toggle(False))
trim = TrimTree(Tree=join_3, Depth=1)
simplify = SimplifyCurve(Curve=trim)  # -> Curve, Simplified

# ---- group: Level1 - Extract points from surfaces & isolate Z coordinate to identify level above ground plane
srfpt = SurfacePoints(Surface=srf_3)  # -> Points, Weights, Greville, UCount, VCount
panel_17 = Panel("""True
False
False
False""")
dispatch = Dispatch(List=srfpt.Points, DispatchPattern=panel_17)  # -> ListA, ListB
pdecon_2 = Deconstruct(Point=dispatch.ListA)  # -> XComponent, YComponent, ZComponent
Z_5 = UnitZ(Factor=pdecon_2.ZComponent)
vlen = VectorLength(Vector=Z_5)
trim_2 = TrimTree(Tree=vlen, Depth=1)
dcon = DeleteConsecutive(Set=trim_2, Wrap=False)  # -> Set, Count
trunc = Truncate(Input=dcon.Set, TruncationFactor=0)

# ---- group: Define file path location
panel_18 = Panel("C:\Users\hans.palacios\Documents\My Files\01_DTM\Tickets\20170208 - Rhino To Revit\RhinoExport")

# ---- group: File name (.csv)
panel_19 = Panel("grid1")
panel_20 = Panel("grid2")
panel_21 = Panel("grid3")
panel_22 = Panel("grid4")

# ---- group: Set to True to Export
toggle_3 = BooleanToggle(False)

# ---- group: Grid Distances
item_4 = ListItem(List=flatten(arrcurve_2.Geometry), Index=0, Wrap=True)
item_5 = ListItem(List=flatten(arrcurve_2.Geometry), Index=1, Wrap=True)
item_6 = ListItem(List=flatten(arrcurve.Geometry), Index=0, Wrap=True)
item_7 = ListItem(List=flatten(arrcurve.Geometry), Index=1, Wrap=True)
end = EndPoints(Curve=item_4)  # -> Start, End
end_2 = EndPoints(Curve=item_5)  # -> Start, End
end_3 = EndPoints(Curve=item_6)  # -> Start, End
end_4 = EndPoints(Curve=item_7)  # -> Start, End
dist = Distance(PointA=end.Start, PointB=end_2.Start)
dist_2 = Distance(PointA=end_3.Start, PointB=end_4.Start)
panel_23 = Panel(dist)
panel_24 = Panel(dist_2)

# ----
line = Line(ext)

# ---- group: Level1 - Extract number of floors & use as Level Names (Add 1 to shift index from 0)
trim_3 = TrimTree(Tree=simplify.Curve, Depth=1)
lng = ListLength(List=trim_3)
series = Series(Start=0, Step=1, Count=lng)
addition = Addition(A=series, B="1")
concat = Concatenate(FragmentA="Level ", FragmentB=addition)
unflatten = UnflattenTree(Tree=concat, Guide=simplify.Curve)
trim_4 = TrimTree(Tree=unflatten, Depth=1)
panel_25 = Panel(trim_4)

# ---- group: True - Export
toggle_4 = BooleanToggle(False)

# ---- group: Level1 - Export
# This has to be grafted because the
# curve list is flattened.  This
# allows the grids to be created.
panel_26 = Panel("C:\Users\hans.palacios\Documents\My Files\01_DTM\Tickets\20170208 - Rhino To Revit\RhinoExport")
grids = Grids(WriteToggle=toggle_4, FolderPath=panel_26, CsvFileName="grid1", Curves=graft(line))  # -> Output, Data
panel_30 = Panel(grids.Output)
panel_31 = Panel(grids.Data)

# ---- group: Define file path location
panel_32 = Panel("C:\Users\hans.palacios\Documents\My Files\01_DTM\Tickets\20170208 - Rhino To Revit\RhinoExport")

panel_33 = Panel("C:\Users\hans.palacios\Documents\My Files\01_DTM\Tickets\20170208 - Rhino To Revit\RhinoExport")

# ---- group: File name (.csv)
panel_34 = Panel("floors1")
panel_35 = Panel("floors2")
panel_36 = Panel("floors3")
panel_37 = Panel("floors4")

panel_38 = Panel("levels1")
panel_39 = Panel("levels2")
panel_40 = Panel("levels4")
panel_41 = Panel("levels3")

# ---- group: Set to True to Export
toggle_5 = BooleanToggle(False)

toggle_6 = BooleanToggle(False)

# ---- group: Revit floor type
panel_42 = Panel("Concrete Slab")

# ----
# GRIDS
# Grid Creation
number_slider = Slider(25, range=0..50)
series_2 = Series(Start=0, Step=number_slider, Count=Slider(13, range=0..50))
series_3 = Series(Start=0, Step=Slider(25, range=0..50), Count=Slider(18, range=0..50))
line_2 = Line(Line((-2897.995339, -6488.924805, 0), (-2593.444025, -6488.924805, 0)))
X_3 = UnitX(Factor=series_2)
Y = UnitY(Factor=series_3)
end_5 = EndPoints(Curve=line_2)  # -> Start, End
move_3 = Move(Geometry=line_2, Motion=Y)  # -> Geometry, Transform
item_8 = ListItem(List=move_3.Geometry, Index="-1", Wrap=True)
end_6 = EndPoints(Curve=item_8)  # -> Start, End
ln_4 = Line(StartPoint=end_5.Start, EndPoint=end_6.Start)
move_4 = Move(Geometry=ln_4, Motion=X_3)  # -> Geometry, Transform

# ---- group: Export levels to CSV file
levels = Levels(WriteToggle=toggle_5, FolderPath=panel_33, CsvFileName=panel_38, LevelElevation=trunc, LevelName=trim_4)  # -> Output, Data
panel_43 = Panel(levels.Data)
panel_44 = Panel(levels.Output)

# ---- group: Export floors to CSV file
floors = Floors(WriteToggle=toggle_6, FolderPath=panel_32, CsvFileName=panel_34, RevitTypeName=panel_42, DataTreeSource=simplify.Curve)  # -> Output, Data
panel_45 = Panel(floors.Output)
panel_46 = Panel(floors.Data)

# ---- group: True - Export
toggle_7 = BooleanToggle(False)

# ----
panel_47 = Panel("C:\Users\hans.palacios\Documents\My Files\01_DTM\Tickets\20170208 - Rhino To Revit\RhinoExport")

# ---- group: True - Export
toggle_8 = BooleanToggle(False)

# ---- group: Original Pass / True - Export
toggle_9 = BooleanToggle(False)

toggle_10 = BooleanToggle(False)

# ----
brep_24 = Brep(<brep referenced from the Rhino model>)
# CORE - Large
debrep_7 = DeconstructBrep(Brep=brep_24)  # -> Faces, Edges, Vertices
boxprop_4 = BoxProperties(Box=brep_24)  # -> Center, Diagonal, Area, Volume, Degeneracy
division_5 = Division(A=boxprop_4.Volume, B=boxprop_4.Area)
division_6 = Division(A=division_5, B="2")
vec_3 = VectorXYZ(XComponent=0, YComponent=0, ZComponent=division_6)  # -> Vector, Length

# ---- group: Graft to add branch to align with other tree
move_5 = Move(Geometry=boxprop_4.Center, Motion=vec_3.Vector)  # -> Geometry, Transform

# ----
project_5 = ProjectPoint(Point=move_5.Geometry, Direction=Vector(0, 0, -1), Geometry=debrep_7.Faces)  # -> Point, Index
panel_48 = Panel(move_5.Geometry)
item_9 = ListItem(List=debrep_7.Faces, Index=project_5.Index, Wrap=True)
panel_49 = Panel(project_5.Index)
srf_6 = Surface(item_9)
edges_4 = BrepEdges(Brep=srf_6)  # -> graft(Naked), Interior, NonManifold

crv_7 = Curve(edges_4.Naked)
walls_2 = Walls(WriteToggle=toggle_2, FolderPath=panel_13, CsvFileName="core2", Curves=crv_7, RevitTypeName="Core Wall")  # -> Output, Data
panel_50 = Panel(walls_2.Data)
panel_51 = Panel(walls_2.Output)

debrep_8 = DeconstructBrep(Brep=brep_16)  # -> Faces, Edges, Vertices
boxprop_5 = BoxProperties(Box=brep_16)  # -> Center, Diagonal, Area, Volume, Degeneracy
division_7 = Division(A=boxprop_5.Volume, B=boxprop_5.Area)
division_8 = Division(A=division_7, B="2")
vec_4 = VectorXYZ(XComponent=0, YComponent=0, ZComponent=division_8)  # -> Vector, Length
Z_6 = UnitZ(Factor=1)

# ---- group: Graft to add branch to align with other tree
move_6 = Move(Geometry=boxprop_5.Center, Motion=vec_4.Vector)  # -> graft(Geometry), Transform

# ----
project_6 = ProjectPoint(Point=move_6.Geometry, Direction=Z_6, Geometry=debrep_8.Faces)  # -> Point, Index
panel_52 = Panel(move_6.Geometry)
item_10 = ListItem(List=debrep_8.Faces, Index=project_6.Index, Wrap=True)
panel_53 = Panel(project_6.Index)
srf_7 = Surface(item_10)

# ----
# This has to be flattened because the
# surface list from the previous process
# was grafted 1 tree branch too much.  This
# allows the levels to be created.
srf_8 = Surface(flatten(srf_7))
panel_54 = Panel(srf_8)
join_4 = BrepJoin(Breps=srf_8)  # -> Breps, Closed
srf_9 = Surface(join_4.Breps)
clean = CleanTree(RemoveNulls=True, RemoveInvalid=True, RemoveEmpty=False, Tree=srf_9)
panel_55 = Panel(clean)

# ---- group: Level1 - Extract points from surfaces & isolate Z coordinate to identify level above ground plane
srfpt_2 = SurfacePoints(Surface=srf_9)  # -> Points, Weights, Greville, UCount, VCount
panel_56 = Panel("""True
False
False
False""")
dispatch_2 = Dispatch(List=srfpt_2.Points, DispatchPattern=panel_56)  # -> ListA, ListB
pdecon_3 = Deconstruct(Point=dispatch_2.ListA)  # -> XComponent, YComponent, ZComponent
Z_7 = UnitZ(Factor=pdecon_3.ZComponent)
vlen_2 = VectorLength(Vector=Z_7)
trim_5 = TrimTree(Tree=vlen_2, Depth=1)
panel_57 = Panel(trim_5)

# ---- group: Floor1 - Extract curves from surfaces & join individual curves into closed curves per level
edges_5 = BrepEdges(Brep=srf_9)  # -> Naked, Interior, NonManifold
crv_8 = Curve(edges_5.Naked)
join_5 = JoinCurves(Curves=crv_8, Preserve=Toggle(False))
trim_6 = TrimTree(Tree=join_5, Depth=1)
simplify_2 = SimplifyCurve(Curve=trim_6)  # -> Curve, Simplified
panel_58 = Panel(simplify_2.Curve)

# ----
dcon_2 = DeleteConsecutive(Set=trim_5, Wrap=False)  # -> Set, Count
trunc_2 = Truncate(Input=dcon_2.Set, TruncationFactor=0)

# ---- group: Level1 - Extract number of floors & use as Level Names (Add 1 to shift index from 0)
trim_7 = TrimTree(Tree=simplify_2.Curve, Depth=1)
lng_2 = ListLength(List=trim_7)
series_4 = Series(Start=0, Step=1, Count=lng_2)
addition_2 = Addition(A=series_4, B="1")
concat_2 = Concatenate(FragmentA="Level ", FragmentB=addition_2)
unflatten_2 = UnflattenTree(Tree=concat_2, Guide=simplify_2.Curve)
trim_8 = TrimTree(Tree=unflatten_2, Depth=1)
panel_59 = Panel(trim_8)

# ----
panel_60 = Panel(trunc_2)

# ---- group: Floor1 - Export
panel_62 = Panel("C:\Users\hans.palacios\Documents\My Files\01_DTM\Tickets\20170208 - Rhino To Revit\RhinoExport")
floors_2 = Floors(
    WriteToggle=Toggle(False),
    FolderPath=panel_62,
    CsvFileName="floors1",
    RevitTypeName="Concrete Slab",
    DataTreeSource=simplify_2.Curve)  # -> Output, Data
panel_66 = Panel(floors_2.Output)
panel_67 = Panel(floors_2.Data)

# ----
item_11 = ListItem(List=trunc_2, Index="-1", Wrap=True)
panel_68 = Panel(item_11)

# ---- group: Level1 - Export
panel_69 = Panel("C:\Users\hans.palacios\Documents\My Files\01_DTM\Tickets\20170208 - Rhino To Revit\RhinoExport")
levels_2 = Levels(WriteToggle=toggle_7, FolderPath=panel_69, CsvFileName="levels1", LevelElevation=trunc_2, LevelName=trim_8)  # -> Output, Data
panel_73 = Panel(levels_2.Data)
panel_74 = Panel(levels_2.Output)

# ----
box_corners_2 = BoxCorners(Box=project.Geometry)  # -> CornerA, CornerB, CornerC, CornerD, CornerE, CornerF, CornerG, CornerH
ln_5 = Line(StartPoint=box_corners_2.CornerB, EndPoint=box_corners_2.CornerA)
ln_6 = Line(StartPoint=box_corners_2.CornerC, EndPoint=box_corners_2.CornerB)
ln_7 = Line(StartPoint=box_corners_2.CornerD, EndPoint=box_corners_2.CornerC)
offset = Offset(Curve=[ln_5, ln_7], Distance=x_axis_offset, Plane=PlaneXY(0, 0, 0), Corners=x_axis_offset)  # -> flatten(Curve)

ln_8 = Line(StartPoint=box_corners_2.CornerA, EndPoint=box_corners_2.CornerD)

offset_2 = Offset(Curve=[ln_6, ln_8], Distance=y_axis_offset, Plane=PlaneXY(0, 0, 0), Corners=y_axis_offset)  # -> flatten(Curve)
ptuvcrvs = IntersectCurves(CU=offset_2, CV=offset)
dispatch_3 = Dispatch(List=ptuvcrvs, DispatchPattern=[True, False])  # -> flatten(ListA), flatten(ListB)
dispatch_4 = Dispatch(List=ptuvcrvs, DispatchPattern=[True, False])  # -> ListA, ListB
dispatch_5 = Dispatch(List=[dispatch_3.ListA, dispatch_3.ListB], DispatchPattern=[True, False])  # -> ListA, ListB
ln_9 = Line(StartPoint=dispatch_4.ListA, EndPoint=dispatch_4.ListB)  # -> flatten(Line)
ln_10 = Line(StartPoint=dispatch_5.ListA, EndPoint=dispatch_5.ListB)  # -> flatten(Line)
dispatch_6 = Dispatch(List=ln_9, DispatchPattern=[True, False])  # -> ListA, ListB
dispatch_7 = Dispatch(List=ln_10, DispatchPattern=[True, False])  # -> ListA, ListB
crv_9 = Curve(dispatch_7.ListA)
crv_10 = Curve(dispatch_7.ListB)
crv_11 = Curve(dispatch_6.ListA)
crv_12 = Curve(dispatch_6.ListB)
arrcurve_3 = CurveArray(Geometry=crv_11, Curve=crv_10, Count=y_axis_grid)  # -> Geometry, Transform
arrcurve_4 = CurveArray(Geometry=crv_9, Curve=crv_12, Count=x_axis_grid)  # -> Geometry, Transform
ext_2 = ExtendCurve(Curve=[arrcurve_4.Geometry, arrcurve_3.Geometry], Type=0, Start=grid_line_extension, End=grid_line_extension)

# ---- group: Grid Distances
item_12 = ListItem(List=arrcurve_3.Geometry, Index=0, Wrap=True)
item_13 = ListItem(List=arrcurve_3.Geometry, Index=1, Wrap=True)
item_14 = ListItem(List=arrcurve_4.Geometry, Index=0, Wrap=True)
item_15 = ListItem(List=arrcurve_4.Geometry, Index=1, Wrap=True)
end_7 = EndPoints(Curve=item_12)  # -> Start, End
end_8 = EndPoints(Curve=item_13)  # -> Start, End
end_9 = EndPoints(Curve=item_14)  # -> Start, End
end_10 = EndPoints(Curve=item_15)  # -> Start, End
dist_3 = Distance(PointA=end_7.Start, PointB=end_8.Start)
dist_4 = Distance(PointA=end_9.Start, PointB=end_10.Start)

# ---- group: Export grids to CSV file
# This has to be grafted because the
# curve list is flattened.  This
# allows the grids to be created.
line_3 = Line(ext_2)
grids_2 = Grids(WriteToggle=toggle_3, FolderPath=panel_18, CsvFileName=panel_19, Curves=graft(line_3))  # -> Output, Data
panel_75 = Panel(grids_2.Output)
panel_76 = Panel(grids_2.Data)

# ---- group: Distance between y-axis grids
panel_77 = Panel(dist_3)

# ---- group: Distance between x-axis grids
panel_78 = Panel(dist_4)

# ---- group: Original Pass
brep_25 = Brep([<brep referenced from the Rhino model> x19])
debrep_9 = DeconstructBrep(Brep=brep_25)  # -> Faces, Edges, Vertices
boxprop_6 = BoxProperties(Box=brep_25)  # -> Center, Diagonal, Area, Volume, Degeneracy
division_9 = Division(A=boxprop_6.Volume, B=boxprop_6.Area)
division_10 = Division(A=division_9, B="2")
vec_5 = VectorXYZ(XComponent=0, YComponent=0, ZComponent=division_10)  # -> Vector, Length
Z_8 = UnitZ(Factor=1)

# ---- group: Original Pass / Graft to add branch to align with other tree
move_7 = Move(Geometry=boxprop_6.Center, Motion=vec_5.Vector)  # -> graft(Geometry), Transform

# ---- group: Original Pass (continued)
project_7 = ProjectPoint(Point=move_7.Geometry, Direction=Z_8, Geometry=debrep_9.Faces)  # -> Point, Index
panel_79 = Panel(move_7.Geometry)
item_16 = ListItem(List=debrep_9.Faces, Index=project_7.Index, Wrap=True)
panel_80 = Panel(project_7.Index)
srf_10 = Surface(item_16)

# ---- group: Original Pass / Surfaces1 - Surfaces for each floor slab from RH model
srf_11 = Surface(flatten(srf_10))
panel_81 = Panel(srf_11)

# ---- group: Original Pass / Level1 - Extract points from surfaces & isolate Z coordinate to identify level above ground plane
srfpt_3 = SurfacePoints(Surface=srf_11)  # -> Points, Weights, Greville, UCount, VCount
panel_82 = Panel("""True
False
False
False""")
dispatch_8 = Dispatch(List=srfpt_3.Points, DispatchPattern=panel_82)  # -> ListA, ListB
pdecon_4 = Deconstruct(Point=dispatch_8.ListA)  # -> XComponent, YComponent, ZComponent
Z_9 = UnitZ(Factor=pdecon_4.ZComponent)
vlen_3 = VectorLength(Vector=Z_9)
trim_9 = TrimTree(Tree=vlen_3, Depth=1)
panel_83 = Panel(trim_9)

# ---- group: Original Pass / Floor1 - Extract curves from surfaces & join individual curves into closed curves per level
edges_6 = BrepEdges(Brep=srf_11)  # -> Naked, Interior, NonManifold
crv_13 = Curve(edges_6.Naked)
join_6 = JoinCurves(Curves=crv_13, Preserve=Toggle(False))
trim_10 = TrimTree(Tree=join_6, Depth=1)
simplify_3 = SimplifyCurve(Curve=trim_10)  # -> Curve, Simplified
panel_84 = Panel(simplify_3.Curve)

# ---- group: Original Pass / Level1 - Extract number of floors & use as Level Names (Add 1 to shift index from 0)
trim_11 = TrimTree(Tree=simplify_3.Curve, Depth=1)
lng_3 = ListLength(List=trim_11)
series_5 = Series(Start=0, Step=1, Count=lng_3)
addition_3 = Addition(A=series_5, B="1")
concat_3 = Concatenate(FragmentA="Level ", FragmentB=addition_3)
unflatten_3 = UnflattenTree(Tree=concat_3, Guide=simplify_3.Curve)
trim_12 = TrimTree(Tree=unflatten_3, Depth=1)
panel_85 = Panel(trim_12)

# ---- group: Original Pass
# CORE - Small
dcon_3 = DeleteConsecutive(Set=trim_9, Wrap=False)  # -> Set, Count
trunc_3 = Truncate(Input=dcon_3.Set, TruncationFactor=0)
panel_86 = Panel(trunc_3)
toggle_11 = BooleanToggle(False)
item_17 = ListItem(List=trunc_3, Index="-1", Wrap=True)
panel_87 = Panel(item_17)
panel_88 = Panel("C:\Users\hans.palacios\Documents\My Files\01_DTM\Tickets\20170208 - Rhino To Revit\RhinoExport")

# ---- group: Original Pass / Floor1 - Export
panel_89 = Panel("C:\Users\hans.palacios\Documents\My Files\01_DTM\Tickets\20170208 - Rhino To Revit\RhinoExport")
floors_3 = Floors(
    WriteToggle=toggle_11,
    FolderPath=panel_89,
    CsvFileName="floors",
    RevitTypeName="Concrete Slab",
    DataTreeSource=simplify_3.Curve)  # -> Output, Data
panel_90 = Panel(floors_3.Data)
panel_91 = Panel(floors_3.Output)

# ---- group: Original Pass / Level1 - Export
panel_92 = Panel("C:\Users\hans.palacios\Documents\My Files\01_DTM\Tickets\20170208 - Rhino To Revit\RhinoExport")
levels_3 = Levels(WriteToggle=toggle_9, FolderPath=panel_92, CsvFileName="levels", LevelElevation=trunc_3, LevelName=trim_12)  # -> Output, Data
panel_93 = Panel(levels_3.Data)
panel_94 = Panel(levels_3.Output)

# ----
brep_26 = Brep(<brep referenced from the Rhino model>)
# CORE - Large
debrep_10 = DeconstructBrep(Brep=brep_26)  # -> Faces, Edges, Vertices
boxprop_7 = BoxProperties(Box=brep_26)  # -> Center, Diagonal, Area, Volume, Degeneracy
division_11 = Division(A=boxprop_7.Volume, B=boxprop_7.Area)
division_12 = Division(A=division_11, B="2")
vec_6 = VectorXYZ(XComponent=0, YComponent=0, ZComponent=division_12)  # -> Vector, Length

# ---- group: Graft to add branch to align with other tree
move_8 = Move(Geometry=boxprop_7.Center, Motion=vec_6.Vector)  # -> Geometry, Transform

# ----
project_8 = ProjectPoint(Point=move_8.Geometry, Direction=Vector(0, 0, -1), Geometry=debrep_10.Faces)  # -> Point, Index
panel_95 = Panel(move_8.Geometry)
item_18 = ListItem(List=debrep_10.Faces, Index=project_8.Index, Wrap=True)
panel_96 = Panel(project_8.Index)
srf_12 = Surface(item_18)
edges_7 = BrepEdges(Brep=srf_12)  # -> graft(Naked), Interior, NonManifold

crv_14 = Curve(edges_7.Naked)
walls_3 = Walls(
    WriteToggle=toggle_8,
    FolderPath=panel_47,
    CsvFileName="core2",
    Curves=crv_14,
    RevitTypeName="Core Wall",
    RevitWallHeight=item_11)  # -> Output, Data
panel_97 = Panel(walls_3.Data)
panel_98 = Panel(walls_3.Output)

# ---- group: Original Pass
brep_27 = Brep(<brep referenced from the Rhino model>)
debrep_11 = DeconstructBrep(Brep=brep_27)  # -> Faces, Edges, Vertices
boxprop_8 = BoxProperties(Box=brep_27)  # -> Center, Diagonal, Area, Volume, Degeneracy
division_13 = Division(A=boxprop_8.Volume, B=boxprop_8.Area)
division_14 = Division(A=division_13, B="2")
vec_7 = VectorXYZ(XComponent=0, YComponent=0, ZComponent=division_14)  # -> Vector, Length

# ---- group: Original Pass / Graft to add branch to align with other tree
move_9 = Move(Geometry=boxprop_8.Center, Motion=vec_7.Vector)  # -> Geometry, Transform

# ---- group: Original Pass (continued)
project_9 = ProjectPoint(Point=move_9.Geometry, Direction=Vector(0, 0, -1), Geometry=debrep_11.Faces)  # -> Point, Index
panel_99 = Panel(move_9.Geometry)
item_19 = ListItem(List=debrep_11.Faces, Index=project_9.Index, Wrap=True)
panel_100 = Panel(project_9.Index)
srf_13 = Surface(item_19)
edges_8 = BrepEdges(Brep=srf_13)  # -> graft(Naked), Interior, NonManifold

crv_15 = Curve(edges_8.Naked)
walls_4 = Walls(
    WriteToggle=toggle_10,
    FolderPath=panel_88,
    CsvFileName="core",
    Curves=crv_15,
    RevitTypeName="Core Wall",
    RevitWallHeight=item_17)  # -> Output, Data
panel_101 = Panel(walls_4.Data)
panel_102 = Panel(walls_4.Output)
